# Dynamo graph flattenList.dyf
# category: Lists

number = DoubleInput(1)
# note: A list we're going to build into.
lst = Input()
# note: Drop the first element from the
# incoming list...
drop = DropList(number, lst)
count = Length(drop)
# note: If the length of the list after
# the drop is less than 1...
lt = LessThan(count, number)
final_list = Input()
# note: A list of lists.
number_2 = DoubleInput(0)
# note: Get the first element in the list,
# which is a list.
get = GetFromList(number_2, lst)
append = Append(final_list, get)
# note: Otherwise, loop...
# note: Return the result of
# the last append operation.
flattenList = Output(drop, append)
if_ = Conditional(lt, append, flattenList)
