# Dynamo graph listOfItems.dyf "ListOfItems"
# category: Lists

item = Input()
lst = Input()
cons = List(item, lst)
count = Length(cons)
count_2 = Input(count)
lt = LessThan(count, count_2)
ListOfItems = Output(item, cons, count_2)
if_ = Conditional(lt, ListOfItems, cons)
